# Grasshopper definition TSPDemo.gh (Grasshopper 1.0.7)
# plug-ins: BH.UI.Grasshopper

getinfo = GetInfo(Component="{ .GetInfo")
# <Script name>
project_number = Panel("")
setprojectid = SetProjectID(ProjectID=project_number, Component="{ .SetProjectID")
bhom_version_used_to_create = Panel("5.0")
bhom_version_currently_installed = Panel(getinfo)
crv = Curve(<curve referenced from the Rhino model>)
crv_2 = Curve(<curve referenced from the Rhino model>)
direction = Direction(Line=crv, Tolerance=1e-06, Component="{ .Direction")
plansettings = PlanSettings(
    MinimumUnits=1,
    MaximumUnits=10,
    MinimumUnitsSpace=2,
    MaximumPlacementAttempts=10,
    SiteBoundary=crv_2,
    PrincipleDirection=direction,
    Component="BH.oM.TSP.PlanSettings")
unit = Unit(X=8, Y=15, Z=3.5, CoordinateSystem="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", Component="BH.oM.TSP.Unit")
verticalsettings = VerticalSettings(MaximumLevel=10, GapToHeightRatio=1, Component="BH.oM.TSP.VerticalSettings")
generate = Generate(PrototypeUnit=unit, Settings=plansettings, Component="{ .Generate")  # -> Bars, Field
use = Use(
    {"Circulation": 0, "Open": 1, "Occupied": 2, "Unoccupied": 3, "OutsideBoundary": 4}, selected="Open",
    Component="BH.oM.TSP.Use",
    Selection=1)
cellsbyuse = CellsByUse(Field=generate.Field, Use=use, Component="{ .CellsByUse")
levels = Levels(Field=generate.Field, Unit=unit, Settings=verticalsettings, Component="{ .Levels")
massing = Massing(Bars=generate.Bars, Field=levels, PrototypeUnit=unit, Component="{ .Massing")
explode = Explode(Object=massing, Component="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")  # -> Units, Cells, BHoM_Guid, Name, Fragments, Tags, CustomData
unitmesh = UnitMesh(Bars=massing, Field=generate.Field, PrototypeUnit=unit, Component="{ .UnitMesh")
